# Grasshopper definition StockPriceLandscape.gh (Grasshopper 1.0.7)
# plug-ins: Hops

# ---- group: Canvas Settings / _in
change_background_color = Button()
# Script by:
# Timo Harboe Nielsen
update_wires_and_groups = Button()

# ----
group_names_to_ignore = Panel("_ignore")

# ---- group: Canvas Settings
group_names_corresponding_to_colors_belo = Panel("""_in
_analysis
_out
_visual""")  # "Group names corresponding to colors below"
groups_with_hidden_wires = Panel("_visual")
color = ColourSwatch(SwatchColor=RGBA(255, 231, 54, 150))
color_2 = ColourSwatch(SwatchColor=RGBA(255, 189, 189, 150))
color_3 = ColourSwatch(SwatchColor=RGBA(156, 255, 215, 150))
color_4 = ColourSwatch(SwatchColor=RGBA(232, 224, 255, 150))
merge = Merge(Data1=color, Data2=color_4, Data3=color_2, Data4=color_3)
bool = Boolean(invert(update_wires_and_groups))
color_5 = ColourSwatch(SwatchColor=RGBA(227, 227, 227, 90))
changebackground = GhPythonScript(
    change=change_background_color,
    newBackgroundColor=RGB(255, 255, 255),
    wireColor=RGB(110, 110, 110),
    selectedWireColor=RGB(47, 255, 0))  # inputs newBackgroundColor: Color, wireColor: Color, selectedWireColor: Color
# ---------- changebackground: Python ----------
import Grasshopper as gh
import rhinoscriptsyntax as rs

newShadeColor = rs.CreateColor(0,0,0,20)
newEdgeColor = rs.CreateColor(0,0,0,40)

if(change):
     gh.GUI.Canvas.GH_Skin.canvas_back = newBackgroundColor
     gh.GUI.Canvas.GH_Skin.canvas_shade = newShadeColor
     gh.GUI.Canvas.GH_Skin.canvas_edge = newEdgeColor
     gh.GUI.Canvas.GH_Skin.wire_default = wireColor
     gh.GUI.Canvas.GH_Skin.wire_selected_a = selectedWireColor
     gh.GUI.Canvas.GH_Skin.wire_selected_b = selectedWireColor
# ---------- end changebackground ----------
group_color = GroupColor(
    run=bool,
    groupNames=group_names_corresponding_to_colors_belo,
    groupNamesIgnore=group_names_to_ignore,
    colors=merge,
    defaultColor=color_5)  # inputs run: Boolean, groupNames: list of String, groupNamesIgnore: list of String, colors: list of Color, defaultColor: Color
# ---------- group_color: C# usings ----------
using System.Drawing;
using Grasshopper.Kernel.Special;
# ---------- group_color: C# ----------
    // Created by Timo Harboe Nielsen - Rambøll.

    if(!run){
      return;
    }
    GH_Document doc = owner.OnPingDocument();
    foreach (var dobj in doc.Objects)
    {
      GH_Group _group = dobj as GH_Group;
      if( _group == null){
        continue;
      }
      string groupName = _group.NickName.ToString();

      bool changeColor = true;
      //Check if groupName is to be ignored
      for(int i = 0; i < groupNamesIgnore.Count; i++){
        string compareName = groupNamesIgnore[i];
        if(groupName.IndexOf(compareName, StringComparison.OrdinalIgnoreCase) >= 0){
          changeColor = false;
        }
      }

      if(!changeColor){continue;}

      for(int i = 0; i < Math.Min(groupNames.Count, colors.Count); i++){
        string compareName = groupNames[i];
        if(groupName.IndexOf(compareName, StringComparison.OrdinalIgnoreCase) >= 0){
          _group.Colour = colors[i];
          break;
        } else{
          _group.Colour = defaultColor;
        }
      }
    }
# ---------- end group_color ----------
update_wires_icons = FaintWires(updateWires=bool, hiddenGroups=groups_with_hidden_wires)  # inputs updateWires: Boolean, hiddenGroups: list of String
# ---------- update_wires_icons: C# usings ----------
using System.IO;
using System.Linq;
using System.Data;
using System.Drawing;
using System.Reflection;
using System.Windows.Forms;
using System.Xml;
using System.Xml.Linq;
using System.Runtime.InteropServices;

using Rhino.DocObjects;
using Rhino.Collections;
using GH_IO;
using GH_IO.Serialization;

using Grasshopper.Kernel.Special;
# ---------- update_wires_icons: C# ----------
    //Get ID's of objects in desired groups

    GH_Document doc = owner.OnPingDocument();
    List<System.Guid> objectIDs = new List<System.Guid>();
    foreach (var dobj in doc.Objects)
    {

      GH_Group _group = dobj as GH_Group;
      if( _group == null){
        continue;
      }
      for(int i = 0; i < hiddenGroups.Count; i++){
        string groupName = _group.NickName.ToString();
        string compareName = hiddenGroups[i];
        if(groupName.IndexOf(compareName, StringComparison.OrdinalIgnoreCase) >= 0){
          objectIDs.AddRange(_group.ObjectIDs);
          break;
        }
      }
    }

    // Manipulate wires
    foreach(IGH_ActiveObject activeObject in GrasshopperDocument.ActiveObjects()){
      if(activeObject.SubCategory == "Primitive" || activeObject.SubCategory == "Geometry"){
        if(activeObject is IGH_Param){
          IGH_Param param = activeObject as IGH_Param;
          if (param != null)
          {
            param.IconDisplayMode = GH_IconDisplayMode.name;
          }
          int wire = 0;  //0 default, 1 faint, 2 hidden
          for(int i = 0; i < param.SourceCount; i++){
            IGH_ActiveObject activeObjectSource = param.Sources[i].Attributes.GetTopLevel.DocObject as IGH_ActiveObject;
            if(activeObjectSource.SubCategory == "Primitive" || activeObjectSource.SubCategory == "Geometry"){
              if(objectIDs.Contains(activeObject.InstanceGuid) && !objectIDs.Contains(activeObjectSource.InstanceGuid)){
                wire = 2;
              } else {
                wire = 1;
              }
            } else{
              wire = 0;
              break;
            }
          }
          if(wire == 1){
            fixWires(param, updateWires);
          }
          if(wire == 2){
            hideWires(param, updateWires);
          }

        }
      }
    }
# ---------- update_wires_icons: C# additional code ----------
  void fixWires(IGH_Param param, bool showFaint){
    if(showFaint){
      param.WireDisplay = GH_ParamWireDisplay.faint;
    } else{
      GH_ParamWireDisplay ParameterDisplayDefault = (GH_ParamWireDisplay) 0;
      param.WireDisplay = ParameterDisplayDefault;
    }
  }

  void hideWires(IGH_Param param, bool showFaint){
    if(showFaint){
      param.WireDisplay = GH_ParamWireDisplay.hidden;
    } else{
      GH_ParamWireDisplay ParameterDisplayDefault = (GH_ParamWireDisplay) 0;
      param.WireDisplay = ParameterDisplayDefault;
    }
  }
# ---------- end update_wires_icons ----------

# ----
hops = Hops(
    _Path="http://127.0.0.1:5000/stockPrice",
    T="Goog",
    CacheResultsInMemory=True,
    CacheSolveResults=True,
    RemoteDefinitionLocation="http://127.0.0.1:5000/stockPrice",
    RemoteSolveVersion=(0, 1, 0),
    ShowInput_Enabled=False,
    ShowInput_Path=True,
    SynchronousSolve=True)
hops_2 = Hops(
    _Path="http://127.0.0.1:5000/stockPrice",
    T="AAPL",
    CacheResultsInMemory=True,
    CacheSolveResults=True,
    RemoteDefinitionLocation="http://127.0.0.1:5000/stockPrice",
    RemoteSolveVersion=(0, 1, 0),
    ShowInput_Enabled=False,
    ShowInput_Path=True,
    SynchronousSolve=True)
P = CullPattern([False, False, False, False, False, False, False, True])
cull = CullPattern(List=hops_2, CullPattern=P)
cull_2 = CullPattern(List=hops, CullPattern=P)
lng = ListLength(List=cull_2)  # -> simplify(Length)
addition = Addition(A=graft(cull_2), B=cull)  # -> simplify(Result)
series = Series(Start=0, Step=1, Count=lng)
division = Division(A=addition, B=Slider(6, range=0..10))
pt = ConstructPoint(XCoordinate=graft(series), YCoordinate=series, ZCoordinate=division)  # -> flatten(Point)
del = DelaunayMesh(Points=pt, Plane=PlaneXY(0, 0, 0))
msmooth = SmoothMesh(Mesh=del, Strength=0.5, SkipNaked=True, Iterations=Slider(10, range=0..10))
demesh = DeconstructMesh(Mesh=msmooth)  # -> Vertices, Faces, Colours, Normals
pdecon = Deconstruct(Point=demesh.Vertices)  # -> XComponent, YComponent, ZComponent
gradient = Gradient(
    LowerLimit=Slider(25, range=0..100),
    UpperLimit=Slider(53, range=0..100),
    Parameter=pdecon.ZComponent,
    stops=[0: RGB(255, 0, 255), 0.0312: RGB(255, 7, 247), 0.0625: RGB(255, 16, 238), 0.0938: RGB(255, 24, 230), 0.125: RGB(255, 31, 223), 0.156: RGB(255, 39, 215)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])
conmesh = ConstructMesh(Vertices=demesh.Vertices, Faces=demesh.Faces, Colours=gradient)
